# Grasshopper definition 261003_mvp_base_v02_fx.gh (Grasshopper 1.0.8)

# ---- group: INPUT
crv_public_area = Curve(<curve referenced from the Rhino model>)
crv_route = Curve(<curve referenced from the Rhino model>)

# ---- group: INPUT: BOUNDARY
crv_entrance = Curve(<curve referenced from the Rhino model>)
crv_boundary = Curve(<curve referenced from the Rhino model>)
crv_columns = Curve([<curve referenced from the Rhino model> x6])
py3 = Python3Script(x=crv_boundary, y=crv_entrance, z=crv_columns)  # -> out, a; inputs x: Curve, y: Curve, z: list
# ---------- py3: Python ----------
boundary = x
entrance = y
columns = z

report = []

if boundary is None:
    report.append("ERROR: Connect the office boundary.")
else:
    report.append("Boundary closed: {}".format(boundary.IsClosed))
    report.append("Boundary planar: {}".format(boundary.IsPlanar()))

if entrance is None:
    report.append("ERROR: Connect the entrance threshold.")
else:
    report.append(
        "Entrance length: {:.1f} model units".format(
            entrance.GetLength()
        )
    )

column_list = list(columns) if columns is not None else []
report.append("Column curves received: {}".format(len(column_list)))

a = "\n".join(report)
# ---------- end py3 ----------
panel = Panel(py3.a)

# ---- group: Offset Hallway
corridor_width = Slider(1500, range=0..10000)
xy = XYPlane(Origin=Point(0, 0, 0))
division = Division(A=corridor_width, B="2")
neg = Negative(Value=division)
offset = OffsetCurve(Curve=crv_route, Distance=division, Plane=xy, Corners=1)
offset_2 = OffsetCurve(Curve=crv_route, Distance=neg, Plane=xy, Corners=1)
merge = Merge(Data1=offset, Data2=offset_2)
boundary = BoundarySurfaces(Edges=merge)  # -> flatten(Surfaces)

# ----
crv_public_area_2 = Curve(crv_public_area)
boundary_2 = BoundarySurfaces(Edges=crv_public_area)  # -> flatten(Surfaces)
srf_public_area = Surface(boundary_2)
crv_outer = Curve(offset_2)
srf_hallway = Surface(boundary)
crv_outer_2 = Curve(crv_outer)
chair_clearance = Slider(900, range=0..1000)
desk_width = Slider(1400, range=0..10000)
desk_depth = Slider(700, range=0..1000)
pt_desk_center_test = Point(<point referenced from the Rhino model>)

# ---- group: Circulation Surface
crv_inner = Curve(offset)
crv_public_area_3 = Curve(crv_public_area_2)
xy_2 = XYPlane(Origin=Point(0, 0, 0))
rdiff = RegionDifference(CurvesA=crv_inner, CurvesB=crv_public_area_3, Plane=xy_2)

# ----
merge_2 = Merge(Data1=crv_public_area_3, Data2=crv_outer_2)
runion = RegionUnion(Curves=flatten(merge_2), Plane=xy_2)

# ---- group: Office Area: Isolated from circulation and within boundary
crv_boundary_2 = Curve(<curve referenced from the Rhino model>)
xy_3 = XYPlane(Origin=Point(0, 0, 0))
rint = RegionIntersection(CurvesA=rdiff, CurvesB=crv_boundary_2, Plane=xy_3)
rdiff_2 = RegionDifference(CurvesA=crv_boundary_2, CurvesB=runion, Plane=xy_3)
boundary_3 = BoundarySurfaces(Edges=flatten(rdiff_2))
boundary_4 = BoundarySurfaces(Edges=flatten(rint))
srf_office_inbound = Surface(boundary_4)
srf_office_outbound = Surface(boundary_3)
merge_3 = Merge(Data1=srf_office_inbound, Data2=srf_office_outbound)
srf_office_area = Surface(merge_3)

# ---- group: Circulation Surface (continued)
rdiff_3 = RegionDifference(CurvesA=runion, CurvesB=rdiff, Plane=xy_2)
boundary_5 = BoundarySurfaces(Edges=rdiff_3)
srf_circulation = Surface(boundary_5)

# ---- group: Check for Column, Office Overlaps
crv_outer_office = Curve(rdiff_2)
crv_inner_office = Curve(rint)
crv_columns_2 = Curve([<curve referenced from the Rhino model> x6])
merge_4 = Merge(Data1=crv_inner_office, Data2=crv_outer_office)
xy_4 = XYPlane(Origin=Point(0, 0, 0))
rint_2 = RegionIntersection(CurvesA=merge_4, CurvesB=crv_columns_2, Plane=xy_4)
zero_means_no_overlaps = Panel(rint_2)

# ---- group: Office Area Calculator (sqm)
area = Area(Geometry=srf_office_area)  # -> Area, Centroid
ma = MassAddition(Input=flatten(area.Area))  # -> Result, PartialResults
division_2 = Division(A=ma.Result, B="1000000")
office_area_sqm = Panel(division_2)

# ---- group: Desk Positioning Checker
py3_desk_test = Python3Script(center=pt_desk_center_test, width=desk_width, depth=desk_depth, clearance=chair_clearance)  # -> out, a, b; inputs center: Point3d, clearance: Double
# ---------- py3_desk_test: Python ----------
import Rhino.Geometry as rg

a = None

if center is None:
    print("Connect the desk center point.")
elif width is None or depth is None:
    print("Connect both size sliders.")
elif width <= 0 or depth <= 0:
    print("Desk dimensions must be greater than zero.")
else:
    plane = rg.Plane(center, rg.Vector3d.ZAxis)

    desk = rg.Rectangle3d(
        plane,
        rg.Interval(-width / 2, width / 2),
        rg.Interval(-depth / 2, depth / 2)
    )

    a = desk.ToNurbsCurve()

b = None

if a is not None and clearance is not None:
    if clearance >= 0:
        envelope = rg.Rectangle3d(
            plane,
            rg.Interval(-width / 2, width / 2),
            rg.Interval(-depth / 2 - clearance, depth / 2)
        )
        b = envelope.ToNurbsCurve()
# ---------- end py3_desk_test ----------
crv_desk_footprint = Curve(py3_desk_test.a)
srf_office_area_2 = Surface(srf_office_area)
crv_desk_chair = Curve(py3_desk_test.b)
max_move = Slider(2000, range=0..2000)
step = Slider(50, range=0..100)
py3_desk_fit_check = Python3Script(chairzone=crv_desk_chair, offices=srf_office_area_2)  # -> out, a; inputs chairzone: Curve, offices: list of Brep
# ---------- py3_desk_fit_check: Python ----------
import Rhino
import Rhino.Geometry as rg

desk = chairzone

tol = Rhino.RhinoDoc.ActiveDoc.ModelAbsoluteTolerance

def fits_face(footprint, face):
    planar, plane = face.TryGetPlane(tol)
    if not planar:
        return False

    # Reject geometry outside the office plane.
    bounds = footprint.GetBoundingBox(True)
    if any(abs(plane.DistanceTo(p)) > tol
           for p in bounds.GetCorners()):
        return False

    has_outer = False

    for loop in face.Loops:
        edge = loop.To3dCurve()
        if edge is None:
            return False

        relation = rg.Curve.PlanarClosedCurveRelationship(
            footprint, edge, plane, tol
        )

        if loop.LoopType == rg.BrepLoopType.Outer:
            has_outer = True
            if relation != rg.RegionContainment.AInsideB:
                return False

        elif loop.LoopType == rg.BrepLoopType.Inner:
            if relation != rg.RegionContainment.Disjoint:
                return False

    return has_outer

if desk is None or not offices:
    a = "Connect the desk and office areas."
elif not desk.IsClosed or not desk.IsPlanar(tol):
    a = "Desk must be a closed, planar curve."
else:
    fits = any(
        fits_face(desk, face)
        for office in offices if office is not None
        for face in office.Faces
    )

    a = (
        "PASS: Desk footprint fits inside an office area."
        if fits else
        "FAIL: Desk crosses, touches, or lies outside an office boundary."
    )
# ---------- end py3_desk_fit_check ----------
py3_desk_fit_check_2 = Python3Script(desk=crv_desk_footprint, offices=srf_office_area_2)  # -> out, a; inputs desk: Curve, offices: list of Brep
# ---------- py3_desk_fit_check_2: Python ----------
import Rhino
import Rhino.Geometry as rg

tol = Rhino.RhinoDoc.ActiveDoc.ModelAbsoluteTolerance

def fits_face(footprint, face):
    planar, plane = face.TryGetPlane(tol)
    if not planar:
        return False

    # Reject geometry outside the office plane.
    bounds = footprint.GetBoundingBox(True)
    if any(abs(plane.DistanceTo(p)) > tol
           for p in bounds.GetCorners()):
        return False

    has_outer = False

    for loop in face.Loops:
        edge = loop.To3dCurve()
        if edge is None:
            return False

        relation = rg.Curve.PlanarClosedCurveRelationship(
            footprint, edge, plane, tol
        )

        if loop.LoopType == rg.BrepLoopType.Outer:
            has_outer = True
            if relation != rg.RegionContainment.AInsideB:
                return False

        elif loop.LoopType == rg.BrepLoopType.Inner:
            if relation != rg.RegionContainment.Disjoint:
                return False

    return has_outer

if desk is None or not offices:
    a = "Connect the desk and office areas."
elif not desk.IsClosed or not desk.IsPlanar(tol):
    a = "Desk must be a closed, planar curve."
else:
    fits = any(
        fits_face(desk, face)
        for office in offices if office is not None
        for face in office.Faces
    )

    a = (
        "PASS: Desk footprint fits inside an office area."
        if fits else
        "FAIL: Desk crosses, touches, or lies outside an office boundary."
    )
# ---------- end py3_desk_fit_check_2 ----------
offices = Surface(srf_office_area_2)
desk = Curve(crv_desk_chair)
offices_2 = Surface(offices)
panel_2 = Panel(py3_desk_fit_check_2.a)
panel_3 = Panel(py3_desk_fit_check.a)
py3_desk_move = Python3Script(desk=desk, offices=flatten(offices), step=step, max_move=max_move)  # -> out, a, b, c; inputs desk: Curve, offices: list of Brep, step: Double, max_move: Double
# ---------- py3_desk_move: Python ----------
import Rhino
import Rhino.Geometry as rg

tol = Rhino.RhinoDoc.ActiveDoc.ModelAbsoluteTolerance

def fits_face(footprint, face):
    planar, plane = face.TryGetPlane(tol)
    if not planar:
        return False

    # Reject geometry outside the office plane.
    bounds = footprint.GetBoundingBox(True)
    if any(abs(plane.DistanceTo(p)) > tol
           for p in bounds.GetCorners()):
        return False

    has_outer = False

    for loop in face.Loops:
        edge = loop.To3dCurve()
        if edge is None:
            return False

        relation = rg.Curve.PlanarClosedCurveRelationship(
            footprint, edge, plane, tol
        )

        if loop.LoopType == rg.BrepLoopType.Outer:
            has_outer = True
            if relation != rg.RegionContainment.AInsideB:
                return False

        elif loop.LoopType == rg.BrepLoopType.Inner:
            if relation != rg.RegionContainment.Disjoint:
                return False

    return has_outer

a = None  # Proposed desk-and-chair outline
b = ""    # Report
c = None  # Movement vector

if desk is None or not offices:
    b = "Connect the chair zone and office areas."

elif step is None or max_move is None:
    b = "Connect step and max_move."

elif step <= 0 or max_move < 0:
    b = "Step must be positive; max_move cannot be negative."

elif not desk.IsClosed or not desk.IsPlanar(tol):
    b = "Chair zone must be a closed, planar curve."

else:
    faces = [
        face
        for office in offices if office is not None
        for face in office.Faces
    ]

    if not faces:
        b = "No office faces received."
    else:
        for i in range(int(max_move / step) + 1):
            distance = i * step
            vector = rg.Vector3d(0, distance, 0)

            candidate = desk.DuplicateCurve()
            candidate.Transform(rg.Transform.Translation(vector))

            if any(fits_face(candidate, face) for face in faces):
                a = candidate
                c = vector
                b = (
                    "Already fits; no movement needed."
                    if i == 0 else
                    "Preview: move +Y by {:.0f} mm. "
                    "First passing position at {:.0f} mm steps."
                    .format(distance, step)
                )
                break

        if a is None:
            b = "No passing position found in the sampled +Y moves."
# ---------- end py3_desk_move ----------
crv_desk_footprint_2 = Curve(crv_desk_footprint)
panel_4 = Panel(py3_desk_move.b)
crv_propossed_chair_zone = Curve(py3_desk_move.a)
move = Move(Geometry=crv_desk_footprint_2, Motion=py3_desk_move.c)  # -> Geometry, Transform
py3_desk_fit_check_3 = Python3Script(desk=crv_propossed_chair_zone, offices=offices_2)  # -> out, a; inputs desk: Curve, offices: list of Brep; same code as py3_desk_fit_check_2
panel_5 = Panel(py3_desk_fit_check_3.a)
