# Grasshopper definition 261109_mvp_base_v03_fx.gh (Grasshopper 1.0.8)

# ---- group: INPUT: BOUNDARY
crv_entrance = Curve(<curve referenced from the Rhino model>)
crv_boundary = Curve(<curve referenced from the Rhino model>)
crv_columns = Curve([<curve referenced from the Rhino model> x6])
py3 = Python3Script(x=crv_boundary, y=crv_entrance, z=crv_columns)  # -> out, a; inputs x: Curve, y: Curve, z: list
# ---------- py3: Python ----------
boundary = x
entrance = y
columns = z

report = []

if boundary is None:
    report.append("ERROR: Connect the office boundary.")
else:
    report.append("Boundary closed: {}".format(boundary.IsClosed))
    report.append("Boundary planar: {}".format(boundary.IsPlanar()))

if entrance is None:
    report.append("ERROR: Connect the entrance threshold.")
else:
    report.append(
        "Entrance length: {:.1f} model units".format(
            entrance.GetLength()
        )
    )

column_list = list(columns) if columns is not None else []
report.append("Column curves received: {}".format(len(column_list)))

a = "\n".join(report)
# ---------- end py3 ----------
panel = Panel(py3.a)

# ---- group: INPUT
crv_public_area = Curve(<curve referenced from the Rhino model>)
crv_route = Curve(<curve referenced from the Rhino model>)

# ---- group: Offset Hallway
corridor_width = Slider(1028, range=0..10000)
xy = XYPlane(Origin=Point(0, 0, 0))
division = Division(A=corridor_width, B="2")
neg = Negative(Value=division)
offset = OffsetCurve(Curve=crv_route, Distance=division, Plane=xy, Corners=1)
offset_2 = OffsetCurve(Curve=crv_route, Distance=neg, Plane=xy, Corners=1)
merge = Merge(Data1=offset, Data2=offset_2)
boundary = BoundarySurfaces(Edges=merge)  # -> flatten(Surfaces)

# ----
crv_public_area_2 = Curve(crv_public_area)
boundary_2 = BoundarySurfaces(Edges=crv_public_area)  # -> flatten(Surfaces)
srf_public_area = Surface(boundary_2)
crv_outer = Curve(offset_2)
srf_hallway = Surface(boundary)
crv_outer_2 = Curve(crv_outer)

# ---- group: basic checker index
chair_clearance = Slider(780, range=0..1000)
desk_width = Slider(2446, range=0..10000)
desk_depth = Slider(1000, range=0..1000)
pt_desk_center_test = Point(<point referenced from the Rhino model>)
number_slider = Slider(0, range=0..500)
number_slider_2 = Slider(129, range=45..200)
rotation = Slider(180, range=0..270)

# ---- group: INPUT
# TOGGLE 'TRUE' TO GENERATE CUBICLE LAYOUT
toggle = BooleanToggle(True)
desk_width_2 = Panel("""1400
1600""")
desk_depth_2 = Panel("""700
800""")
number_slider_3 = Slider(100, range=0..1000)
panel_2 = Panel("""0
0.5
1""")
chair_clearance_2 = Panel("""800
1000""")
wall_thickness = Panel("""75
125""")
number_slider_4 = Slider(0, range=0..500)
number_slider_5 = Slider(25, range=0..100)
number_slider_6 = Slider(10, range=0..10)
number_slider_7 = Slider(1, range=0..1)

# ---- group: Circulation Surface
crv_public_area_3 = Curve(crv_public_area_2)
crv_inner = Curve(offset)
xy_2 = XYPlane(Origin=Point(0, 0, 0))
rdiff = RegionDifference(CurvesA=crv_inner, CurvesB=crv_public_area_3, Plane=xy_2)

# ----
merge_2 = Merge(Data1=crv_public_area_3, Data2=crv_outer_2)
runion = RegionUnion(Curves=flatten(merge_2), Plane=xy_2)

# ---- group: Office Area: Isolated from circulation and within boundary
crv_boundary_2 = Curve(<curve referenced from the Rhino model>)
xy_3 = XYPlane(Origin=Point(0, 0, 0))
rint = RegionIntersection(CurvesA=rdiff, CurvesB=crv_boundary_2, Plane=xy_3)
rdiff_2 = RegionDifference(CurvesA=crv_boundary_2, CurvesB=runion, Plane=xy_3)
boundary_3 = BoundarySurfaces(Edges=flatten(rdiff_2))
boundary_4 = BoundarySurfaces(Edges=flatten(rint))
srf_office_inbound = Surface(boundary_4)
srf_office_outbound = Surface(boundary_3)
merge_3 = Merge(Data1=srf_office_inbound, Data2=srf_office_outbound)
srf_office_area = Surface(merge_3)

# ---- group: Circulation Surface (continued)
rdiff_3 = RegionDifference(CurvesA=runion, CurvesB=rdiff, Plane=xy_2)
boundary_5 = BoundarySurfaces(Edges=rdiff_3)
srf_circulation = Surface(boundary_5)

# ----
srf_circulation_2 = Surface(boundary_5)
debrep = DeconstructBrep(Brep=srf_circulation_2)  # -> Faces, Edges, Vertices
explode = Explode(Curve=debrep.Edges, Recursive=True)  # -> Segments, Vertices

# ---- group: Check for Column, Office Overlaps
crv_outer_office = Curve(rdiff_2)
crv_inner_office = Curve(rint)
crv_columns_2 = Curve([<curve referenced from the Rhino model> x6])
merge_4 = Merge(Data1=crv_inner_office, Data2=crv_outer_office)
xy_4 = XYPlane(Origin=Point(0, 0, 0))
rint_2 = RegionIntersection(CurvesA=merge_4, CurvesB=crv_columns_2, Plane=xy_4)
zero_means_no_overlaps = Panel(rint_2)

# ----
crv_candidate_frontages = Curve(flatten(explode.Segments))

# ---- group: Office Area Calculator (sqm)
area = Area(Geometry=srf_office_area)  # -> Area, Centroid
ma = MassAddition(Input=flatten(area.Area))  # -> Result, PartialResults
division_2 = Division(A=ma.Result, B="1000000")
office_area_sqm = Panel(division_2)

# ----
srf_office_area_2 = Surface(srf_office_area)
crv_candidate_frontages_2 = Curve(flatten(crv_candidate_frontages))

# ---- group: LAYOUT GENERATOR
py3_batch_experiments = Python3Script(
    frontages=flatten(crv_candidate_frontages_2),
    offices=flatten(srf_office_area_2),
    widths=flatten(desk_width_2),
    depths=flatten(desk_depth_2),
    clearances=flatten(chair_clearance_2),
    wall_ts=flatten(wall_thickness),
    side_gap=number_slider_4,
    gap=number_slider_3,
    target=number_slider_5,
    trials=number_slider_6,
    seed=number_slider_7,
    run=toggle,
    offsets=flatten(panel_2))  # -> out, a, b, c, d; inputs frontages: list of Curve, offices: list of Brep, widths: list of Double, depths: list of Double, clearances: list of Double, wall_ts: list of Double, side_gap: Double, gap: Double, target: Int32, trials: Int32, seed: Int32, run: Boolean, offsets: list of Double
# ---------- py3_batch_experiments: Python ----------
"""Paste into a Grasshopper Python 3 component; see the accompanying guide."""
import itertools
import json
import math
import random
import Rhino
import Rhino.Geometry as rg

# Inputs: frontages, offices, widths, depths, clearances, wall_ts,
# offsets, side_gap, gap, target, trials, seed, run
# Regular outputs: a (JSON records), b (trade-off points),
# c (progress points), d (report). Keep the special out socket.
a, b, c = [], [], []
d = ""
tol = Rhino.RhinoDoc.ActiveDoc.ModelAbsoluteTolerance
xy = rg.Plane.WorldXY
margin = max(1.0, 2 * tol)


def xy_curve(curve):
    return all(abs(p.Z) <= tol
               for p in curve.GetBoundingBox(True).GetCorners())


def office_regions(items):
    regions = []
    for brep in items:
        if brep is None or not brep.IsValid:
            raise ValueError("Invalid office Brep.")
        for face in brep.Faces:
            planar, unused = face.TryGetPlane(tol)
            if not planar:
                raise ValueError("Office faces must be planar.")
            outer, holes = None, []
            for loop in face.Loops:
                edge = loop.To3dCurve()
                if edge is None or not xy_curve(edge):
                    raise ValueError("Office boundaries must be in World XY.")
                if loop.LoopType == rg.BrepLoopType.Outer:
                    outer = edge
                elif loop.LoopType == rg.BrepLoopType.Inner:
                    holes.append(edge)
            if outer is None:
                raise ValueError("Missing outer office boundary.")
            regions.append((outer, holes))
    return regions


def fits(curve, regions):
    for outer, holes in regions:
        rel = rg.Curve.PlanarClosedCurveRelationship(curve, outer, xy, tol)
        if rel != rg.RegionContainment.AInsideB:
            continue
        if all(rg.Curve.PlanarClosedCurveRelationship(curve, hole, xy, tol)
               == rg.RegionContainment.Disjoint for hole in holes):
            return True
    return False


def point_segment(p, start, end):
    vx, vy = end.X - start.X, end.Y - start.Y
    length2 = vx * vx + vy * vy
    t = 0 if length2 == 0 else max(0.0, min(1.0,
        ((p.X - start.X) * vx + (p.Y - start.Y) * vy) / length2))
    return math.hypot(p.X - start.X - t * vx, p.Y - start.Y - t * vy)


def polygon_distance(pa, pb):
    return min(min(point_segment(p0, q0, q1),
                   point_segment(p1, q0, q1),
                   point_segment(q0, p0, p1),
                   point_segment(q1, p0, p1))
               for p0, p1 in zip(pa[:-1], pa[1:])
               for q0, q1 in zip(pb[:-1], pb[1:]))


def make_slots(edges, regions, w, dep, clear, wall, row_offset):
    total_w = w + 2 * side_gap + 2 * wall
    spacing = max(gap, margin)
    pitch = total_w + spacing
    slots, seen = [], set()
    for edge in edges:
        p0, p1 = edge.PointAtStart, edge.PointAtEnd
        tangent = p1 - p0
        length = tangent.Length
        if length < total_w + 2 * margin:
            continue
        tangent.Unitize()
        number = int(math.floor((length - 2 * margin + spacing) / pitch))
        occupied = number * total_w + (number - 1) * spacing
        slack = max(0.0, length - 2 * margin - occupied)
        first = margin + row_offset * slack + total_w / 2
        for sign in (1, -1):
            xaxis = rg.Vector3d(tangent.X * sign, tangent.Y * sign, 0)
            yaxis = rg.Vector3d(-xaxis.Y, xaxis.X, 0)
            angle = math.degrees(math.atan2(xaxis.Y, xaxis.X)) % 360
            for index in range(number):
                front = p0 + tangent * (first + index * pitch)
                center = front + yaxis * (dep / 2 + clear + margin)
                key = (round(center.X / margin), round(center.Y / margin),
                       round(angle, 6))
                if key in seen:
                    continue
                plane = rg.Plane(center, xaxis, yaxis)
                bounds = (-total_w / 2, total_w / 2,
                          -dep / 2 - clear, dep / 2 + wall)
                x0, x1, y0, y1 = bounds
                polygon = [plane.PointAt(x0, y0), plane.PointAt(x1, y0),
                           plane.PointAt(x1, y1), plane.PointAt(x0, y1),
                           plane.PointAt(x0, y0)]
                curve = rg.PolylineCurve(polygon)
                if fits(curve, regions):
                    seen.add(key)
                    slots.append((center, angle, curve, polygon))
                    if len(slots) > 150:
                        raise ValueError("More than 150 slots; reduce the study size.")
    return slots


def choose(slots, trial_count, random_seed):
    n = len(slots)
    conflicts = [set() for unused in range(n)]
    for i in range(n):
        for j in range(i + 1, n):
            relation = rg.Curve.PlanarClosedCurveRelationship(
                slots[i][2], slots[j][2], xy, tol)
            conflict = relation != rg.RegionContainment.Disjoint
            if not conflict and gap > tol:
                conflict = polygon_distance(slots[i][3], slots[j][3]) < gap - tol
            if conflict:
                conflicts[i].add(j)
                conflicts[j].add(i)
    rng, best = random.Random(random_seed), []
    for trial in range(trial_count):
        order = list(range(n))
        rng.shuffle(order)
        priority = {index: rank for rank, index in enumerate(order)}
        available, selected = set(range(n)), []
        while available:
            if trial % 2 == 0:
                pick = min(available, key=lambda k:
                           (len(conflicts[k] & available), priority[k]))
            else:
                pick = min(available, key=lambda k: priority[k])
            selected.append(pick)
            available.discard(pick)
            available.difference_update(conflicts[pick])
        if len(selected) > len(best):
            best = sorted(selected)
    return best


def main():
    if not run:
        return [], [], [], "Set Run to True. False clears the current outputs."
    if not frontages or not offices:
        raise ValueError("Connect frontages and offices.")
    if any(v is None for v in (side_gap, gap, target, trials, seed)):
        raise ValueError("Connect all scalar controls.")
    if side_gap < 0 or gap < 0 or target < 1 or trials < 1 or trials > 100:
        raise ValueError("Use nonnegative gaps, positive target, and 1-100 trials.")
    options = []
    for name, values, allow_zero in (
        ("widths", widths, False), ("depths", depths, False),
        ("clearances", clearances, True), ("wall_ts", wall_ts, False),
        ("offsets", offsets, True)):
        if not values:
            raise ValueError("Connect {} as a List.".format(name))
        vals = sorted(set(float(v) for v in values))
        if any(not math.isfinite(v) or v < 0 or (v == 0 and not allow_zero)
               for v in vals):
            raise ValueError("Invalid options in {}.".format(name))
        if name == "offsets" and any(v > 1 for v in vals):
            raise ValueError("Offsets must be between 0 and 1.")
        options.append(vals)
    total = math.prod(len(vals) for vals in options)
    if total > 243:
        raise ValueError("Use at most 243 dimension/offset combinations.")
    edges = [edge for edge in frontages if edge is not None and edge.IsValid
             and not edge.IsClosed and edge.IsLinear(tol) and xy_curve(edge)]
    if not edges:
        raise ValueError("No straight World-XY frontage segments received.")
    regions = office_regions(offices)
    records, points, progress = [], [], []
    best_count, met = 0, 0
    for index, dims in enumerate(itertools.product(*options)):
        w, dep, clear, wall, row_offset = dims
        slots = make_slots(edges, regions, w, dep, clear, wall, row_offset)
        selected = choose(slots, int(trials), int(seed))
        number = len(selected)
        clear_area = w * (dep + clear) / 1000000.0
        best_count = max(best_count, number)
        met += int(number >= int(target))
        record = {
            "id": index + 1, "width": w, "depth": dep,
            "clearance": clear, "wall_t": wall, "side_gap": side_gap,
            "gap": gap, "target": int(target), "count": number,
            "shortfall": max(0, int(target) - number),
            "clear_area_m2": clear_area, "candidate_count": len(slots),
            "seed": int(seed), "trials": int(trials),
            "access_checked": False, "row_offset": row_offset,
            "centers": [[slots[k][0].X, slots[k][0].Y, slots[k][0].Z]
                        for k in selected],
            "angles": [slots[k][1] for k in selected]
        }
        records.append(json.dumps(record))
        points.append(rg.Point3d(clear_area, number, 0))
        progress.append(rg.Point3d(index + 1, best_count, 0))
    report = "\n".join([
        "Evaluated {} dimension/offset combinations.".format(total),
        "Target: {}; combinations meeting target: {}.".format(int(target), met),
        "Best geometric count found: {}.".format(best_count),
        "Trade-off plot: X = clear-zone m2/cubicle; Y = cubicle count.",
        "Progress plot: X = combination ID; Y = best count so far.",
        "Target does not cap the count. One offset fraction is applied to all rows per experiment.",
        "Access and other program allocations are not checked.",
        "Counts are search results, not proven maximum capacities."
    ])
    return records, points, progress, report


try:
    a, b, c, d = main()
except Exception as error:
    a, b, c = [], [], []
    d = "ERROR: {}".format(error)
# ---------- end py3_batch_experiments ----------
txt_experiment_records = Text(py3_batch_experiments.a)
pt_trade_off_points = Point(py3_batch_experiments.b)
pt_search_progress = Point(py3_batch_experiments.c)
panel_3 = Panel(py3_batch_experiments.d)
main_index = Slider(0, range=0..47)
pt = ConstructPoint(XCoordinate="0", YCoordinate="0", ZCoordinate="0")
scale = Scale(Geometry=pt_search_progress, Center=pt, Factor="500")  # -> Geometry, Transform
vec = VectorXYZ(XComponent="40000", YComponent="-35000", ZComponent="0")  # -> Vector, Length
move = Move(Geometry=scale.Geometry, Motion=vec.Vector)  # -> Geometry, Transform
py3_preview_experiments = Python3Script(records=flatten(txt_experiment_records), index=main_index)  # -> out, a, b, c, d, e, f, g, h; inputs records: list of String, index: Int32
# ---------- py3_preview_experiments: Python ----------
"""Downstream preview: records (str/List/Flatten), index (int/Item)."""
import json
import math
import Rhino.Geometry as rg

# Keep special out. Regular outputs:
# a desks, b chair zones, c walls, d envelopes, e access points,
# f report, g centers, h angles.
a, b, c, d, e, g, h = [], [], [], [], [], [], []
f = ""


def preview():
    desks, chairs, walls, envelopes, access, centers, angles = (
        [], [], [], [], [], [], [])
    if not records:
        return desks, chairs, walls, envelopes, access, "Run the batch first.", centers, angles
    if index is None or index < 0 or index >= len(records):
        return desks, chairs, walls, envelopes, access, "Index must be 0 to {}.".format(len(records) - 1), centers, angles
    item = json.loads(records[int(index)])
    w, dep = item["width"], item["depth"]
    clear, wall, side = item["clearance"], item["wall_t"], item["side_gap"]
    for xyz, angle in zip(item["centers"], item["angles"]):
        center = rg.Point3d(*xyz)
        plane = rg.Plane(center, rg.Vector3d.ZAxis)
        plane.Rotate(math.radians(angle), rg.Vector3d.ZAxis, center)

        def rectangle(x0, x1, y0, y1):
            return rg.Rectangle3d(plane, rg.Interval(x0, x1),
                                  rg.Interval(y0, y1)).ToNurbsCurve()

        left, right = -w / 2 - side, w / 2 + side
        front, rear = -dep / 2 - clear, dep / 2
        desks.append(rectangle(-w / 2, w / 2, -dep / 2, dep / 2))
        chairs.append(rectangle(-w / 2, w / 2, front, rear))
        walls.extend([
            rectangle(left - wall, left, front, rear),
            rectangle(right, right + wall, front, rear),
            rectangle(left - wall, right + wall, rear, rear + wall)])
        envelopes.append(rectangle(left - wall, right + wall, front, rear + wall))
        access.append(plane.PointAt(0, front))
        centers.append(center)
        angles.append(angle)
    report = "\n".join([
        "Candidate ID: {} (preview index {}).".format(item["id"], int(index)),
        "Geometric count: {}; target: {}.".format(item["count"], item["target"]),
        "Desk: {:.0f} x {:.0f} mm.".format(w, dep),
        "Chair clearance: {:.0f} mm; walls: {:.0f} mm.".format(clear, wall),
        "Row offset fraction: {:g}.".format(item.get("row_offset", 0.5)),
        "Clear-zone area: {:.3f} m2/cubicle.".format(item["clear_area_m2"]),
        "Access remains unchecked."
    ])
    return desks, chairs, walls, envelopes, access, report, centers, angles


try:
    a, b, c, d, e, f, g, h = preview()
except Exception as error:
    a, b, c, d, e, g, h = [], [], [], [], [], [], []
    f = "ERROR: {}".format(error)
# ---------- end py3_preview_experiments ----------
pline = PolyLine(Vertices=flatten(move.Geometry), Closed=False)
crv_experiment_desks = Curve(py3_preview_experiments.a)
crv_experiment_walls = Curve(py3_preview_experiments.c)
panel_4 = Panel(py3_preview_experiments.f)
crv_experiment_chair_zone = Curve(py3_preview_experiments.b)
crv_experiment_envelopes = Curve(py3_preview_experiments.d)
pt_experiment_access_point = Point(py3_preview_experiments.e)
pt_2 = ConstructPoint(XCoordinate="40000", YCoordinate="0", ZCoordinate="0")
py3_plot_experiments = Python3Script(records=flatten(txt_experiment_records), index=main_index, origin=pt_2)  # -> out, a, b, c, d, e, f; inputs records: list of String, index: Int32, origin: Point3d
# ---------- py3_plot_experiments: Python ----------
import json
import math
import Rhino.Geometry as rg

a = []
b = None
c = []
d = []
e = []
f = ""

if not records:
    f = "Connect the experiment records."

elif origin is None:
    f = "Connect the graph origin point."

elif index is None or index < 0 or index >= len(records):
    f = "Select a valid experiment index."

else:
    items = [json.loads(record) for record in records]

    # Graph dimensions in Rhino model units.
    graph_width = 12000.0
    graph_height = 8000.0

    areas = [item["clear_area_m2"] for item in items]
    counts = [item["count"] for item in items]

    xmin = min(areas)
    xmax = max(areas)

    # Add horizontal padding; handle identical area values.
    padding = max((xmax - xmin) * 0.1, 0.1)
    xmin = max(0.0, xmin - padding)
    xmax += padding

    ymin = 0.0
    ymax = max(5.0, math.ceil(max(counts) / 5.0) * 5.0)

    def chart_point(area, number):
        x = (area - xmin) / (xmax - xmin) * graph_width
        y = (number - ymin) / (ymax - ymin) * graph_height

        return rg.Point3d(
            origin.X + x,
            origin.Y + y,
            origin.Z
        )

    def label(x, y, text):
        d.append(rg.Point3d(
            origin.X + x,
            origin.Y + y,
            origin.Z
        ))
        e.append(text)

    # Horizontal and vertical axes.
    c = [
        rg.LineCurve(
            origin,
            rg.Point3d(origin.X + graph_width, origin.Y, origin.Z)
        ),
        rg.LineCurve(
            origin,
            rg.Point3d(origin.X, origin.Y + graph_height, origin.Z)
        )
    ]

    # Tick marks and numerical labels.
    for tick in range(5):
        fraction = tick / 4.0

        x = fraction * graph_width
        xvalue = xmin + fraction * (xmax - xmin)

        c.append(rg.LineCurve(
            rg.Point3d(origin.X + x, origin.Y, origin.Z),
            rg.Point3d(origin.X + x, origin.Y - 120, origin.Z)
        ))
        label(x, -400, "{:.2f}".format(xvalue))

        y = fraction * graph_height
        yvalue = fraction * ymax

        c.append(rg.LineCurve(
            rg.Point3d(origin.X, origin.Y + y, origin.Z),
            rg.Point3d(origin.X - 120, origin.Y + y, origin.Z)
        ))
        label(-800, y, "{:g}".format(yvalue))

    label(
        graph_width * 0.25, -1100,
        "X: desk + chair clear-zone area (m2/cubicle)"
    )
    label(
        0, graph_height + 700,
        "Y: geometric cubicle count"
    )

    # Plot every experiment, preserving record order.
    groups = {}

    for item in items:
        area = item["clear_area_m2"]
        number = item["count"]

        a.append(chart_point(area, number))

        key = (round(area, 9), number)
        groups.setdefault(key, []).append(item["id"])

    # Identical results share a position; list their IDs together.
    for (area, number), ids in groups.items():
        point = chart_point(area, number)
        d.append(rg.Point3d(
            point.X + 150, point.Y + 150, point.Z
        ))
        e.append("ID " + ", ".join(str(value) for value in ids))

    selected = items[int(index)]
    b = a[int(index)]

    f = "\n".join([
        "Selected candidate ID: {}".format(selected["id"]),
        "Preview index: {}".format(int(index)),
        "Geometric count: {}".format(selected["count"]),
        "Clear-zone area: {:.3f} m2/cubicle".format(
            selected["clear_area_m2"]
        ),
        "Desk: {:.0f} x {:.0f} mm".format(
            selected["width"], selected["depth"]
        ),
        "Chair clearance: {:.0f} mm".format(selected["clearance"]),
        "Wall thickness: {:.0f} mm".format(selected["wall_t"]),
        "Access remains unchecked."
    ])
# ---------- end py3_plot_experiments ----------
boundary_6 = BoundarySurfaces(Edges=graft(crv_experiment_walls))
pt_selected_experiment_points = Point(py3_plot_experiments.b)
crv_graph_axes = Curve(py3_plot_experiments.c)
pt_all_experiment_points = Point(py3_plot_experiments.a)
panel_5 = Panel(py3_plot_experiments.f)
py3_cubicle_collision_check = Python3Script(envelopes=flatten(crv_experiment_envelopes))  # -> out, a, b, c; inputs envelopes: list of Curve
# ---------- py3_cubicle_collision_check: Python ----------
import Rhino
import Rhino.Geometry as rg

tol = Rhino.RhinoDoc.ActiveDoc.ModelAbsoluteTolerance
plane = rg.Plane.WorldXY

a = ""
b = []
c = []

items = list(envelopes) if envelopes is not None else []
invalid = []

# Validate inputs before comparing them.
for i, curve in enumerate(items):
    if curve is None:
        invalid.append(i + 1)
        continue

    if not curve.IsValid or not curve.IsClosed:
        invalid.append(i + 1)
        continue

    if not curve.IsPlanar(tol):
        invalid.append(i + 1)
        continue

    bounds = curve.GetBoundingBox(True)
    if any(abs(p.Z) > tol for p in bounds.GetCorners()):
        invalid.append(i + 1)

if not items:
    a = "Connect the cubicle envelopes."

elif invalid:
    a = (
        "CHECK NOT RUN. Invalid or non-XY envelopes: "
        + ", ".join(str(i) for i in invalid)
    )

else:
    conflicting_ids = set()

    # Each unique pair is checked once.
    for i in range(len(items)):
        for j in range(i + 1, len(items)):
            relation = rg.Curve.PlanarClosedCurveRelationship(
                items[i], items[j], plane, tol
            )

            if relation != rg.RegionContainment.Disjoint:
                conflicting_ids.update([i, j])
                c.append(
                    "Cubicle {} vs Cubicle {}".format(i + 1, j + 1)
                )

    b = [items[i] for i in sorted(conflicting_ids)]

    if c:
        a = "FAIL: {} conflicting pairs; {} cubicles involved.".format(
            len(c), len(b)
        )
    else:
        a = "PASS: No conflicts among {} cubicles.".format(len(items))
# ---------- end py3_cubicle_collision_check ----------
py3_cubicle_fit_check = Python3Script(desk=crv_experiment_envelopes, offices=flatten(srf_office_area_2))  # -> out, a; inputs desk: Curve, offices: list of Brep
# ---------- py3_cubicle_fit_check: Python ----------
import Rhino
import Rhino.Geometry as rg

tol = Rhino.RhinoDoc.ActiveDoc.ModelAbsoluteTolerance

def fits_face(footprint, face):
    planar, plane = face.TryGetPlane(tol)
    if not planar:
        return False

    # Reject geometry outside the office plane.
    bounds = footprint.GetBoundingBox(True)
    if any(abs(plane.DistanceTo(p)) > tol
           for p in bounds.GetCorners()):
        return False

    has_outer = False

    for loop in face.Loops:
        edge = loop.To3dCurve()
        if edge is None:
            return False

        relation = rg.Curve.PlanarClosedCurveRelationship(
            footprint, edge, plane, tol
        )

        if loop.LoopType == rg.BrepLoopType.Outer:
            has_outer = True
            if relation != rg.RegionContainment.AInsideB:
                return False

        elif loop.LoopType == rg.BrepLoopType.Inner:
            if relation != rg.RegionContainment.Disjoint:
                return False

    return has_outer

if desk is None or not offices:
    a = "Connect the desk and office areas."
elif not desk.IsClosed or not desk.IsPlanar(tol):
    a = "Desk must be a closed, planar curve."
else:
    fits = any(
        fits_face(desk, face)
        for office in offices if office is not None
        for face in office.Faces
    )

    a = (
        "PASS: Desk footprint fits inside an office area."
        if fits else
        "FAIL: Desk crosses, touches, or lies outside an office boundary."
    )
# ---------- end py3_cubicle_fit_check ----------
crv = Curve(py3_cubicle_collision_check.b)
panel_6 = Panel(py3_cubicle_fit_check.a)
panel_7 = Panel(py3_cubicle_collision_check.c)
panel_8 = Panel(py3_cubicle_collision_check.a)
tag = TextTag3D(Location=py3_plot_experiments.d, Text=py3_plot_experiments.e, Size=Slider(150, range=0..1000), Justification=7)

# ---- group: Desk Positioning Checker
py3_desk_test = Python3Script(center=pt_desk_center_test, width=desk_width, depth=desk_depth, clearance=chair_clearance)  # -> out, a, b; inputs center: Point3d, clearance: Double
# ---------- py3_desk_test: Python ----------
import Rhino.Geometry as rg

a = None

if center is None:
    print("Connect the desk center point.")
elif width is None or depth is None:
    print("Connect both size sliders.")
elif width <= 0 or depth <= 0:
    print("Desk dimensions must be greater than zero.")
else:
    plane = rg.Plane(center, rg.Vector3d.ZAxis)

    desk = rg.Rectangle3d(
        plane,
        rg.Interval(-width / 2, width / 2),
        rg.Interval(-depth / 2, depth / 2)
    )

    a = desk.ToNurbsCurve()

b = None

if a is not None and clearance is not None:
    if clearance >= 0:
        envelope = rg.Rectangle3d(
            plane,
            rg.Interval(-width / 2, width / 2),
            rg.Interval(-depth / 2 - clearance, depth / 2)
        )
        b = envelope.ToNurbsCurve()
# ---------- end py3_desk_test ----------
srf_office_area_3 = Surface(srf_office_area_2)
crv_desk_footprint = Curve(py3_desk_test.a)
crv_desk_chair = Curve(py3_desk_test.b)
max_move = Slider(2000, range=0..2000)
step = Slider(50, range=0..100)
py3_desk_fit_check = Python3Script(chairzone=crv_desk_chair, offices=srf_office_area_3)  # -> out, a; inputs chairzone: Curve, offices: list of Brep
# ---------- py3_desk_fit_check: Python ----------
import Rhino
import Rhino.Geometry as rg

desk = chairzone

tol = Rhino.RhinoDoc.ActiveDoc.ModelAbsoluteTolerance

def fits_face(footprint, face):
    planar, plane = face.TryGetPlane(tol)
    if not planar:
        return False

    # Reject geometry outside the office plane.
    bounds = footprint.GetBoundingBox(True)
    if any(abs(plane.DistanceTo(p)) > tol
           for p in bounds.GetCorners()):
        return False

    has_outer = False

    for loop in face.Loops:
        edge = loop.To3dCurve()
        if edge is None:
            return False

        relation = rg.Curve.PlanarClosedCurveRelationship(
            footprint, edge, plane, tol
        )

        if loop.LoopType == rg.BrepLoopType.Outer:
            has_outer = True
            if relation != rg.RegionContainment.AInsideB:
                return False

        elif loop.LoopType == rg.BrepLoopType.Inner:
            if relation != rg.RegionContainment.Disjoint:
                return False

    return has_outer

if desk is None or not offices:
    a = "Connect the desk and office areas."
elif not desk.IsClosed or not desk.IsPlanar(tol):
    a = "Desk must be a closed, planar curve."
else:
    fits = any(
        fits_face(desk, face)
        for office in offices if office is not None
        for face in office.Faces
    )

    a = (
        "PASS: Desk footprint fits inside an office area."
        if fits else
        "FAIL: Desk crosses, touches, or lies outside an office boundary."
    )
# ---------- end py3_desk_fit_check ----------
py3_desk_fit_check_2 = Python3Script(desk=crv_desk_footprint, offices=srf_office_area_3)  # -> out, a; inputs desk: Curve, offices: list of Brep; same code as py3_cubicle_fit_check
offices = Surface(srf_office_area_3)
desk = Curve(crv_desk_chair)
offices_2 = Surface(offices)
panel_9 = Panel(py3_desk_fit_check_2.a)
panel_10 = Panel(py3_desk_fit_check.a)
py3_desk_move = Python3Script(desk=desk, offices=flatten(offices), step=step, max_move=max_move)  # -> out, a, b, c; inputs desk: Curve, offices: list of Brep, step: Double, max_move: Double
# ---------- py3_desk_move: Python ----------
import Rhino
import Rhino.Geometry as rg

tol = Rhino.RhinoDoc.ActiveDoc.ModelAbsoluteTolerance

def fits_face(footprint, face):
    planar, plane = face.TryGetPlane(tol)
    if not planar:
        return False

    # Reject geometry outside the office plane.
    bounds = footprint.GetBoundingBox(True)
    if any(abs(plane.DistanceTo(p)) > tol
           for p in bounds.GetCorners()):
        return False

    has_outer = False

    for loop in face.Loops:
        edge = loop.To3dCurve()
        if edge is None:
            return False

        relation = rg.Curve.PlanarClosedCurveRelationship(
            footprint, edge, plane, tol
        )

        if loop.LoopType == rg.BrepLoopType.Outer:
            has_outer = True
            if relation != rg.RegionContainment.AInsideB:
                return False

        elif loop.LoopType == rg.BrepLoopType.Inner:
            if relation != rg.RegionContainment.Disjoint:
                return False

    return has_outer

a = None  # Proposed desk-and-chair outline
b = ""    # Report
c = None  # Movement vector

if desk is None or not offices:
    b = "Connect the chair zone and office areas."

elif step is None or max_move is None:
    b = "Connect step and max_move."

elif step <= 0 or max_move < 0:
    b = "Step must be positive; max_move cannot be negative."

elif not desk.IsClosed or not desk.IsPlanar(tol):
    b = "Chair zone must be a closed, planar curve."

else:
    faces = [
        face
        for office in offices if office is not None
        for face in office.Faces
    ]

    if not faces:
        b = "No office faces received."
    else:
        for i in range(int(max_move / step) + 1):
            distance = i * step
            vector = rg.Vector3d(0, distance, 0)

            candidate = desk.DuplicateCurve()
            candidate.Transform(rg.Transform.Translation(vector))

            if any(fits_face(candidate, face) for face in faces):
                a = candidate
                c = vector
                b = (
                    "Already fits; no movement needed."
                    if i == 0 else
                    "Preview: move +Y by {:.0f} mm. "
                    "First passing position at {:.0f} mm steps."
                    .format(distance, step)
                )
                break

        if a is None:
            b = "No passing position found in the sampled +Y moves."
# ---------- end py3_desk_move ----------
crv_desk_footprint_2 = Curve(crv_desk_footprint)
panel_11 = Panel(py3_desk_move.b)
crv_propossed_chair_zone = Curve(py3_desk_move.a)
move_2 = Move(Geometry=crv_desk_footprint_2, Motion=py3_desk_move.c)  # -> Geometry, Transform
py3_desk_fit_check_3 = Python3Script(desk=crv_propossed_chair_zone, offices=offices_2)  # -> out, a; inputs desk: Curve, offices: list of Brep; same code as py3_cubicle_fit_check
panel_12 = Panel(py3_desk_fit_check_3.a)
